# Grasshopper definition app.gh (Grasshopper 1.0.7)
# plug-ins: Hops

concatenate = Concatenate(FragmentA="http://127.0.0.1:5000", FragmentB="/moreRandomPoints")
number_slider = Slider(10, range=0..10)
hops = Hops(
    _Path=concatenate,
    Count=Slider(24, range=0..100),
    XRangeOfRandomness=number_slider,
    YRangeOfRandomness=number_slider,
    ZRangeOfRandomness=number_slider,
    TolRangeOfTolerance=Slider(1, range=0..1),
    CacheResultsInMemory=True,
    CacheSolveResults=True,
    RemoteDefinitionLocation="http://127.0.0.1:5000/moreRandomPoints",
    RemoteSolveVersion=(0, 1, 0),
    ShowInput_Enabled=False,
    ShowInput_Path=True,
    SynchronousSolve=True)  # -> RandomSpheres, RandomPts, RandomCvs, PointsAt, S_sph
