# Grasshopper definition app.gh (Grasshopper 1.0.7)

concatenate = Concatenate(FragmentA="http://127.0.0.1:5000", FragmentB="/createGraph")
S = Slider(4, range=0..10)
Y = Slider(15, range=0..100)
L = Slider(5, range=0..10)
X = Slider(12, range=0..100)
