# Grasshopper definition geometry.gh (Grasshopper 1.0.7)
# plug-ins: treesloth01, Pufferfish, Kangaroo2 Components

number_slider = Slider(4, range=0..10)
square = Square(Plane=PlaneXY(0, 0, 0), Size=1, ExtentX=number_slider, ExtentY=number_slider)  # -> Cells, Points
point = Point(square.Points)
curve = Curve(square.Cells)
shift_paths = ShiftPaths(Data=curve, Offset=-1)
list_item = ListItem(List=shift_paths, Index=0, Wrap=True)
explode = Explode(Curve=shift_paths, Recursive=True)  # -> Segments, Vertices
explode_2 = Explode(Curve=list_item, Recursive=True)  # -> Segments, Vertices
cull_duplicates = CullDuplicates(Points=explode.Vertices, Tolerance=Slider(0.01, range=0..0.01), CullMode=1)  # -> flatten(Points), Indices, Valence
list_indices = ListIndices(List=cull_duplicates.Points)
panel = Panel(list_indices)

number_slider_2 = Slider(10, range=0..10)
negative = Negative(Value=number_slider_2)
unit_x = UnitX(Factor=1)
construct_point = ConstructPoint(XCoordinate=Slider(0, range=0..10), YCoordinate=0, ZCoordinate=0)
construct_domain = ConstructDomain(DomainStart=number_slider_2, DomainEnd=negative)
linear_array = LinearArray(Geometry=construct_point, Direction=unit_x, Count=Slider(12, range=0..100))  # -> Geometry, Transform
rectangle = Rectangle(Plane=PlaneXY(0, 0, 0), XSize=construct_domain, YSize=construct_domain, Radius=0)  # -> Rectangle, Length
deconstruct = Deconstruct(Point=linear_array.Geometry)  # -> XComponent, YComponent, ZComponent
sine = Sine(Value=deconstruct.XComponent)
populate_2d = Populate2D(Region=rectangle.Rectangle, Count=100, Seed=1)
# N
construct_point_2 = ConstructPoint(XCoordinate=deconstruct.XComponent, YCoordinate=sine, ZCoordinate=0)
shift_list = ShiftList(List=construct_point_2, Shift=1, Wrap=True)
unit_y = UnitY(Factor=Slider(5, range=0..10))
proximity_2d = Proximity2D(
    Points=populate_2d,
    Plane=PlaneXY(0, 0, 0),
    Group=Slider(4, range=0..10),
    MinRadius=Slider(0.879, range=0..10),
    MaxRadius=Slider(3.007, range=0..10))  # -> Links, Topology
concatenate = Concatenate(FragmentA="http://127.0.0.1:5000", FragmentB="/createGraph")
line = Line(StartPoint=construct_point_2, EndPoint=shift_list)
move = Move(Geometry=construct_point_2, Motion=unit_y)  # -> Geometry, Transform
curve_2 = Curve(flatten(proximity_2d.Links))
explode_3 = Explode(Curve=curve_2, Recursive=True)  # -> flatten(Segments), flatten(Vertices)
cull_index = CullIndex(List=line, Indices="-1", Wrap=True)
shift_list_2 = ShiftList(List=move.Geometry, Shift=1, Wrap=True)
# E
number_slider_3 = Slider(4, range=0..10)
line_2 = Line(StartPoint=move.Geometry, EndPoint=shift_list_2)
removeduplicatelines = RemoveDuplicateLines(Lines=explode_3.Segments, Tolerance=0.01)
cull_duplicates_2 = CullDuplicates(Points=explode_3.Vertices, Tolerance=0.1, CullMode=3)  # -> Points, Indices, Valence
cull_index_2 = CullIndex(List=line_2, Indices="-1", Wrap=True)
list_item_2 = ListItem(List=construct_point_2, Index=number_slider_3, Wrap=True)
list_item_3 = ListItem(List=move.Geometry, Index=number_slider_3, Wrap=True)
# E
curve_3 = Curve(removeduplicatelines)
# N
point_2 = Point(cull_duplicates_2.Points)
line_3 = Line(StartPoint=list_item_2, EndPoint=list_item_3)

# ----
# N
merge = Merge(Data1=construct_point_2, Data2=move.Geometry)  # -> flatten(Result)
# E
merge_2 = Merge(Data1=cull_index, Data2=line_3, Data3=cull_index_2)  # -> flatten(Result)
